# Grasshopper definition TestFileCAM.gh (Grasshopper 1.0.8)
# plug-ins: CamGh

mesh = Mesh(<mesh referenced from the Rhino model>)
mesh_2 = Mesh(<mesh referenced from the Rhino model>)
preview = CustomPreview(Geometry=mesh_2, Material=ColourSwatch(SwatchColor=RGBA(255, 255, 120, 56)))
stock = Stock(StockBox=mesh)  # -> Stock, Summary
cut_params = CutParameters(
    Stepover=Slider(100, range=0..100),
    Stepdown=Slider(100, range=0..100),
    Pattern="Offset",
    Engage="Ramp",
    Retract="Vertical",
    ClearanceMode="Automatic",
    ClearanceOffset=10,
    StockToLeave=0.5)  # -> CutParameters, Summary
machine = MachineSetup(Name="Default 3-axis", Units="Millimetres", SafeStartZ=0)
tool = Tool(Diameter=Slider(20, range=0..100), Shape="Flat", Flutes=2, RPM=18000)  # -> Tool, CuttingSpeed, Summary
h_rough = HorizontalRoughing(PartMesh=mesh_2, Tool=tool.Tool, CutParameters=cut_params.CutParameters, GridResolution=0)  # -> Command, Summary
cam_core = CAMCore(Commands=h_rough.Command, Stock=stock.Stock)  # -> Toolpath, OperationResults, Summary, Engine
crv = Curve(cam_core.Toolpath)
disc = Discontinuity(Curve=crv, Level=1)  # -> Points, Parameters
